vi "Lab2RxTemplate.gvi"   [LabVIEW Communications System Design Software 2.0.1]
panel controls:
  "IQ rate": f64 = 1000000
  "carrier frequency": f64 = 915000000
  "gain (dB)": f64
  "active antenna": string = "RX2"
  "number of samples": i64 = 200000
  "stop": bool
  "niUSRP Device": "niUSRPClass"
  "filter type": T2 = "Lowpass"
panel indicators:
  "actual IQ rate": f64
  "actual carrier frequency": f64
  "actual gain (dB)": f64
  "error out": error
  "Baseband Output": f64[]
  "Power Spectrum": T1
types:
  T1 = cluster{"f0": f64, "df": f64, "magnitude": f64[]}
  T2 = enum{"Lowpass", "Highpass", "Bandpass", "Bandstop"}
diagram:
  call "niUSRP Open Rx Session.gvi"(niUSRP Device=$"niUSRP Device") -> (error out=w1, session handle out=w2)
  call "niUSRP Configure Signal.gvi"(session handle=w2, IQ rate=$"IQ rate", carrier frequency=$"carrier frequency", gain=$"gain (dB)", error in (no error)=w1, active antenna=$"active antenna") -> (session handle out=w3, coerced IQ rate=w4, coerced carrier frequency=w5, coerced gain=w6, Error Out=w7)
  call "niUSRP Initiate.gvi"(session handle=w3, error in (no error)=w7) -> (session handle out=w8, Error Out=w9)
  w10 = $"number of samples"
  while {
    call "niUSRP Fetch Rx Data (CDB WDT).gvi"(session handle=w8, number of samples=w10, error in (no error)=w9) -> (session handle out=w11, data=w12, Error Out=w13)
    Property Node(instance in=w12) -> ("Y"=w14, "dt"=w15)  # Waveform Properties
    call "Chebyshev Filter (CDB).gvi"(filter type=$"filter type", X=w14, sampling freq: fs=w4, high cutoff freq: fh=105000, low cutoff freq: fl=95000, ripple(dB)=0.1, order=5) -> (Filtered X=w16)
    Complex To Real Imaginary(x + iy=w16) -> (x=w17)
    Absolute Value(x=w17) -> w18
    call "Butterworth Filter (DBL).gvi"(filter type="Lowpass", X=w18, sampling freq: fs=w4, high cutoff freq: fh=100000, low cutoff freq: fl=100, order=2) -> (Filtered X=w19)
    $"Baseband Output" <- w19
    w20 = cluster{"t0": timestamp, "dt": f64, "Y": c128[]} {all zero or empty}
    Property Node(instance in=w20, "Y"=w16, "dt"=w15) -> (instance out=w21)
    call "FFT Power Spectrum for 1 Chan (CDB)2.gvi"(time signal=w21, dB On (F)=TRUE) -> (power spectrum=w22)
    $"Power Spectrum" <- w22
    Logical Or(w13, $stop) -> w23
    stop if w23
  }
  call "niUSRP Abort.gvi"(Handle in=w11, error in (no error)=w13) -> (Handle out=w24, Error Out=w25)
  call "niUSRP Close Session.gvi"(handle in=w24, error in=w25) -> (error out=w26)
  call "Simple Error Handler.gvi"(error in=w26) -> (error out=w27)
  $"error out" <- w27
  $"actual IQ rate" <- w4
  $"actual carrier frequency" <- w5
  $"actual gain (dB)" <- w6
