vi "Function.gvi"   [LabVIEW Communications System Design Software 2.0.1]
inputs:
  "waveform in": waveform<f64> = {dt=1, Y=[]}
  "mu": f64
  "amplitude": f64 = 1
  "frequency": f64 = 10
  "numeric cluster in": cluster{"Fs": f64, "#s": f64}
outputs:
  "product": f64[]
panel indicators:
  "sine wave": waveform<f64>
  "Graph_2": T1
types:
  T1 = cluster{"f0": f64, "df": f64, "magnitude": f64[]}
  T2 = cluster{"Timestamp Constant": timestamp, "dt": f64, "Y": f64[]}
uses:
  NI::Analysis::Generation::Sine Waveform.gvi
diagram:
  Property Node(instance in=$"waveform in") -> ("Y"=w1)
  call "Quick Scale 1D.gvi"(X=w1) -> (max|X|=w2)
  Math Node("mu"=$mu, "m"=w1, "mp"=w2) -> ("E"=w3)
  ~~~
  E = 1 + mu*(m/mp);
  ~~~
  Property Node(instance in=$"numeric cluster in") -> ("#s"=w4)
  call "Sine Waveform.gvi"(amplitude=$amplitude, frequency=$frequency, phase in=90, sample rate=2000000, samples=w4, offset=0) -> (sine wave=w5)
  Property Node(instance in=w5) -> ("Y"=w6)
  Multiply(w3, w6) -> w7
  $product <- w7
  $"sine wave" <- w5
  Property Node(instance in=w5) -> ("Y"=w8, "dt"=w9)
  Property Node(instance in=T2 {all zero or empty}, "dt"=w9, "Y"=w8) -> (instance out=w10)
  call "FFT Power Spectrum for 1 Chan (CDB)2.gvi"(time signal=w10, dB On (F)=TRUE) -> (power spectrum=w11)
  $Graph_2 <- w11
