vi "Lab3RxTemplate.gvi"   [LabVIEW Communications System Design Software 2.0.1]
panel controls:
  "IQ rate": f64 = 2000000
  "carrier frequency": f64 = 915000000
  "gain (dB)": f64
  "active antenna": string = "RX2"
  "number of samples": i64 = 200000
  "stop": bool
  "niUSRP Device": "niUSRPClass"
panel indicators:
  "actual IQ rate": f64
  "actual carrier frequency": f64
  "actual gain (dB)": f64
  "error out": error
  "Message 2 out": waveform<f64>
  "Message 1 out": waveform<f64>
  "Power 2": f64
  "Power 1": f64
  "Power Spectrum_2": T1
types:
  T1 = cluster{"f0": f64, "df": f64, "magnitude": f64[]}
  T2 = cluster{"Timestamp Constant": timestamp, "dt": f64, "Y": c128[]}
diagram:
  call "niUSRP Open Rx Session.gvi"(niUSRP Device=$"niUSRP Device") -> (error out=w1, session handle out=w2)
  call "niUSRP Configure Signal.gvi"(session handle=w2, IQ rate=$"IQ rate", carrier frequency=$"carrier frequency", gain=$"gain (dB)", error in (no error)=w1, active antenna=$"active antenna") -> (session handle out=w3, coerced IQ rate=w4, coerced carrier frequency=w5, coerced gain=w6, Error Out=w7)
  call "niUSRP Initiate.gvi"(session handle=w3, error in (no error)=w7) -> (session handle out=w8, Error Out=w9)
  while {
    call "niUSRP Fetch Rx Data (CDB WDT).gvi"(session handle=w8, number of samples=$"number of samples", error in (no error)=w9) -> (session handle out=w10, data=w11, Error Out=w12)
    Property Node(instance in=w11) -> ("Y"=w13, "dt"=w14)
    Property Node(instance in=T2 {all zero or empty}, "dt"=w14, "Y"=w13) -> (instance out=w15)
    call "FFT Power Spectrum for 1 Chan (CDB)2.gvi"(time signal=w15, dB On (F)=TRUE) -> (power spectrum=w16)
    $"Power Spectrum_2" <- w16
    call "Chebyshev Filter (CDB).gvi"(filter type="Bandpass", X=w13, sampling freq: fs=w4, high cutoff freq: fh=505000, low cutoff freq: fl=495000, ripple(dB)=0.1, order=5) -> (Filtered X=w17)
    Absolute Value(x=w17) -> w18
    call "Butterworth Filter (DBL).gvi"(filter type="Lowpass", X=w18, sampling freq: fs=w4, high cutoff freq: fh=0, low cutoff freq: fl=5000, order=3) -> (Filtered X=w19)
    call "AC & DC Estimator.gvi"(Signal (V)=w19) -> (AC estimate (Vrms)=w20)
    Square(x=w20) -> w21
    $"Power 1" <- w21
    Logical Or(w12, $stop) -> w22
    Build Waveform Node(Y=w19, dt=w14) -> (output waveform=w23)
    $"Message 1 out" <- w23
    Property Node(instance in=w11) -> ("Y"=w24, "dt"=w25)
    call "Chebyshev Filter (CDB).gvi"(filter type="Bandpass", X=w24, sampling freq: fs=w4, high cutoff freq: fh=515000, low cutoff freq: fl=505000, ripple(dB)=0.1, order=5) -> (Filtered X=w26)
    Absolute Value(x=w26) -> w27
    call "Butterworth Filter (DBL).gvi"(filter type="Lowpass", X=w27, sampling freq: fs=w4, high cutoff freq: fh=0, low cutoff freq: fl=5000, order=2) -> (Filtered X=w28)
    call "AC & DC Estimator.gvi"(Signal (V)=w28) -> (AC estimate (Vrms)=w29)
    Square(x=w29) -> w30
    $"Power 2" <- w30
    Build Waveform Node(Y=w28, dt=w25) -> (output waveform=w31)
    $"Message 2 out" <- w31
    stop if w22
  }
  call "niUSRP Abort.gvi"(Handle in=w10, error in (no error)=w12) -> (Handle out=w32, Error Out=w33)
  call "niUSRP Close Session.gvi"(handle in=w32, error in=w33) -> (error out=w34)
  call "Simple Error Handler.gvi"(error in=w34) -> (error out=w35)
  $"error out" <- w35
  $"actual IQ rate" <- w4
  $"actual carrier frequency" <- w5
  $"actual gain (dB)" <- w6
